% Simulink data dictionary battery_status.sldd
% references common.sldd

Bus = Simulink.Bus()
  A: single, Unit="A"  % ButteryCurrent
  V: single, Unit="V"  % BatteryV
  Charge: single, Unit="A*hr"  % BatteryCharge
  Power: single, Unit="W"  % BatteryPower
  BatteryLoss: single, Unit="W"  % BatteryLoss

PowerLoss = Simulink.Signal(DataType="double", Unit="W")  % BatteryLoss
Power = Simulink.Signal(DataType="double", Unit="W")  % BatteryPower
Charge = Simulink.Signal(DataType="double", Unit="A*hr")  % BatteryCharge
A = Simulink.Signal(DataType="double", Unit="A")  % BatteryCurrentA
V = Simulink.Signal(DataType="double", Unit="V")  % BatteryV
internal_R_Ohm = Simulink.Parameter(0.01, DataType="double", Unit=" Ohm")  % xz
hvBatteryCharge_Ah = Simulink.Parameter([], DataType="double")
packVoltage_V = Simulink.Parameter(350, DataType="double", Unit="V")  % xz
nominalCapacity_kWh = Simulink.Parameter(4, DataType="double", Unit="kW/h")  % xz
hvBatterySOC_pct = Simulink.Parameter(70, DataType="double", Unit="%")  % to do signal!
AmbTemp = Simulink.Parameter(293.15, DataType="double", Unit="K")  % Kelvin krytoi