% Simulink data dictionary speed_controller.sldd
% references common.sldd

FiltFreq = Simulink.Parameter(20, DataType="single", Unit="Hz")  % LowPassFrequencyFilter
SpdCtrlKi = Simulink.Parameter(60, DataType="single")  % Integral Coefficient
SpdCtrlKp = Simulink.Parameter(60, DataType="single")  % Proportional Coefficient
SpdCtrlTrqMax = Simulink.Parameter(360, DataType="single", Min=300, Max=400, Unit="N*m")  % Max Torque