% Simulink data dictionary vehicle.sldd
% references common.sldd

GearEfficiency = Simulink.Parameter(0.98, DataType="double")
vehicleRoadLoadB_N_per_kph2 = Simulink.Parameter(0.035, DataType="double", Unit="N*hr*hr/km*km")
vehicleRoadLoadB_N_per_kph = Simulink.Parameter(0, DataType="double", Unit="N*hr/km")
vehicleRoadLoadA_N = Simulink.Parameter(100, DataType="double", Unit="N")
vehicleTireRollingRadius_cm = Simulink.Parameter(30, DataType="double", Unit="cm")
vehicleVehMass_kg = Simulink.Parameter(1600, DataType="double", Unit="kg")
motorDriveSimplePmsmDrv_initialRotorSpd_rpm = Simulink.Parameter(0, DataType="double", Unit="rpm")
motorDriveSimplePmsmDrv_rotorDamping_Nm_per_radps = Simulink.Parameter(1.0e-5, DataType="double", Unit="N*m")
motorDriveSimplePmsmDrv_rotorInertia_kg_m2 = Simulink.Parameter(0.000393, DataType="double", Unit="kg*m*m")

motorDriveSimplePmsmDrv_LossTbl_W = Simulink.Parameter([16.02 251 872.8 2230 4998
 29.77 262 875.7 2217 4950
 45.35 281.2 900 2217 4796
 62.14 299 924.8 2191 4567
 81.1 320.9 943.1 2146 4379], DataType="double", Unit="W")  % `

motorDriveSimplePmsmDrv_trqVec_Nm = Simulink.Parameter([10 45 80 115 150], DataType="double", Unit="N*m")
motorDriveSimplePmsmDrv_spdVec_rpm = Simulink.Parameter([100 450 800 1150 1500], DataType="double", Unit="rpm")
motorDriveSimplePmsmDrv_timeConst_s = Simulink.Parameter(0.02, DataType="double", Unit="s")
motorDriveSimplePmsmDrv_powMax_W = Simulink.Parameter(150000, DataType="double", Unit="W")
motorDriveSimplePmsmDrv_trqMax_Nm = Simulink.Parameter(360, DataType="double", Unit="N*m")
batteryInternal_R_Ohm = Simulink.Parameter(0.01, DataType="double", Unit=" Ohm")
batteryPackVoltage_V = Simulink.Parameter(350, DataType="double", Unit="K")
GearRatio = Simulink.Parameter(7, DataType="double")  % xz
AmbTemp = Simulink.Parameter(293.15, DataType="double", Unit="K")  % Kelvin krytoi
hvBatterySOC_pct = Simulink.Parameter(70, DataType="double", Unit="%")  % to do signal!
nominalCapacity_kWh = Simulink.Parameter(4, DataType="double", Unit="kW/h")  % xz
packVoltage_V = Simulink.Parameter(350, DataType="double", Unit="V")  % xz
internal_R_Ohm = Simulink.Parameter(0.01, DataType="double", Unit=" Ohm")  % xz
V = Simulink.Signal(DataType="double", Unit="V")  % BatteryV
A = Simulink.Signal(DataType="double", Unit="A")  % BatteryCurrentA
Charge = Simulink.Signal(DataType="double", Unit="A*hr")  % BatteryCharge
Power = Simulink.Signal(DataType="double", Unit="W")  % BatteryPower
PowerLoss = Simulink.Signal(DataType="double", Unit="W")  % BatteryLoss

BatteryInfo = Simulink.Bus()
  batteryCharge: double, Min=0, Max=12, Unit="A*hr"  % BatteryCharge
  batteryCurrent: double, Unit="A"  % ButteryCurrent
  batteryVoltage: double, Min=0, Max=400, Unit="V"  % BatteryV
  batteryPower: double, Unit="W"  % BatteryPower
  batteryLoss: double, Unit="W"  % BatteryLoss